# Grasshopper definition OpenCV_Example.gh (Grasshopper 1.0.7)
# plug-ins: Hops

K = Slider(3, range=0..10)
index_all = Slider(-1, range=-1..23)
path = FilePath("/Users/yasinturedi/Desktop/Grasshopper_Open_CV_Component/created_images/")
# Open CV Grasshopper integration
# with GH Hops Component
# developed by Yasin Türedi
path_2 = FilePath("/Users/yasinturedi/Desktop/Grasshopper_Open_CV_Component/images/land.png")
panel = Panel("http://127.0.0.1:5000/opencv")
thickness = Slider(2, range=0..8)
treshold = Slider(79, range=0..255)
hops = Hops(
    MainImage=path_2,
    B=K,
    CreatedImageDirectory=path,
    CreatedImageName="img_k_means",
    ImageFormat=".png",
    TresholdNumber=treshold,
    ContourIndex=index_all,
    ContourStroke=thickness,
    ContouredImageName="img_contour",
    SketchedImageName="img_sketch",
    CacheResultsInMemory=False,
    CacheSolveResults=False,
    RemoteDefinitionLocation="http://127.0.0.1:5000/opencv",
    RemoteSolveVersion=(0, 1, 0))  # -> ImageKMeans, ImageContour, ImageSketch
image_resource = ImageResource(hops.ImageKMeans)
image_resource_2 = ImageResource(hops.ImageContour)
image_resource_3 = ImageResource(hops.ImageSketch)
